# Dynamo graph April2015VTSummit_96in_wirecut_foam_test.dyn (Dynamo 0.7.5.3566)

code_block = CodeBlock { w=4.0; l=4.0; h=16.0; o=Point.ByCoordinates(w/2,l/2,h/2); margin=0.05; }
entry_exit_points = CodeBlock(w=code_block.w, l=code_block.l, distance=code_block.h, margin=code_block.margin) { start = Point.ByCoordinates(w/2,l/2,distance+margin); finish = Point.ByCoordinates(w/2,l/2,-margin); }
create = List.Create(entry_exit_points.start)
code_block_2 = CodeBlock(distance=code_block.h, margin=code_block.margin, spread=code_block.w)
# ---------- code_block_2.designscript (6 lines) ----------
s = distance+margin..-margin..-(distance+margin*2)/1600;
l = Math.Abs(s - 1/3 * distance);
path1 = 0.105 * l + 0.32 * Math.Sin(Math.Log(0.12 * l + 0.022) * Math.PI * 144) + spread/2 - 0.4;
path2 = -0.12 * l + 0.19 * Math.Sin(Math.Log(l*l + 0.022) * Math.PI * 96) + spread/2 + 0.6;
p1 = Point.ByCoordinates(path1, spread/2, s);
p2 = Point.ByCoordinates(path2, spread/2, s);
# ----------------------------------------
byPoints = NurbsCurve.ByPoints(code_block_2.p2)
number_of_sample_points = IntegerSlider(500, range=0..500)
code_block_3 = CodeBlock(x=number_of_sample_points) { 0..1..1/x; }
pointAtParameter = Curve.PointAtParameter(byPoints, code_block_3)
create_2 = List.Create(entry_exit_points.finish)
join = List.Join(create, pointAtParameter, create_2)
inches_to_mm_x_6 = CodeBlock { 6*25.4; }
scale = Vector.Scale(join, inches_to_mm_x_6)
starting_orientation = CodeBlock { 0.5920; -0.3866; 0.3866; -0.5920; }
end_orientation = CodeBlock { 0.3419; -0.6189; 0.6189; -0.3419; }
code_block_4 = CodeBlock(q1a=starting_orientation.out0, q1b=end_orientation.out0, x=number_of_sample_points, q2a=starting_orientation.out1, q2b=end_orientation.out1, q3a=starting_orientation.out2, q3b=end_orientation.out2, q4a=starting_orientation.out3, q4b=end_orientation.out3)
# ---------- code_block_4.designscript (4 lines) ----------
q1 = q1a..q1b..(q1b-q1a)/(x+2);
q2 = q2a..q2b..(q2b-q2a)/(x+2);
q3 = q3a..q3b..(q3b-q3a)/(x+2);
q4 = q4a..q4b..(q4b-q4a)/(x+2);
# ----------------------------------------
code_block_5 = CodeBlock { 0; -1; 0; 0; }
targetAtPointAndOrient = Dynamo_ABB.DynamoABB.TargetAtPointAndOrient(scale, code_block_4.q1, code_block_4.q2, code_block_4.q3, code_block_4.q4, code_block_5.out0, code_block_5.out1, code_block_5.out2, code_block_5.out3)
code_block_6 = CodeBlock { path="c:\\Users\\michael\\Desktop\\MainModule.mod"; }
tool_pose = CodeBlock { Point.ByCoordinates(-10.7947, -3.07574, 1408.09); 0.866742; -0.0200232; -0.015347; 0.498118; }
robotPose = Dynamo_ABB.DynamoABB.RobotPose(tool_pose.out0, tool_pose.out1, tool_pose.out2, tool_pose.out3, tool_pose.out4)
work_pose = CodeBlock { Point.ByCoordinates(3000,100,0); 1; 0; 0; 0; }
robotPose_2 = Dynamo_ABB.DynamoABB.RobotPose(work_pose.out0, work_pose.out1, work_pose.out2, work_pose.out3, work_pose.out4)
code_block_7 = CodeBlock { speed = 30; zone = 1; }
writeRapidFile = Dynamo_ABB.DynamoABB.WriteRapidFile(targetAtPointAndOrient, code_block_6, robotPose, robotPose_2, code_block_7.speed, code_block_7.zone)
byPoints_2 = NurbsCurve.ByPoints(code_block_2.p1)
byLengths = Cuboid.ByLengths(code_block.o, code_block.w, code_block.l, code_block.h)
Z = Vector.Z(code_block_2.p1)
minimumItem = List.MinimumItem(Z)
maximumItem = List.MaximumItem(Z)
X = Vector.X(code_block_2.p1)
maximumItem_2 = List.MaximumItem(X)
minimumItem_2 = List.MinimumItem(X)
